# Grasshopper definition Circle Relaxation.gh (Grasshopper 1.0.7)
# plug-ins: ScriptParasite

circle = Circle(Plane=PlaneXY(0, 0, 0), Radius=1)
surface = Surface(circle)
populate_geometry = PopulateGeometry(Geometry=surface, Count=Slider(35, range=0..100), Seed=1)
number_slider = Slider(25, range=0..30)
trigger = Trigger(Interval=50, TimerInterval=50, Target=circle_relaxation)

circle_relaxation = CSharpScript(
    iReset=Toggle(False),
    iPoints=populate_geometry,
    iSubIterationCounts=Slider(1, range=0..10),
    iCollisionDistance=number_slider)  # -> out, A; inputs iReset: Boolean, iPoints: list of Point3d, iSubIterationCounts: Int32, iCollisionDistance: Double
# ---------- circle_relaxation: C# usings ----------
using System.Security.Principal;
# ---------- circle_relaxation: C# ----------
    if (iReset)
    {
      pointList = new List<Point3d>(iPoints);
      A = GetCircles(pointList, circleList, iCollisionDistance);
    }
    else
    {
      for (int i = 0; i < iSubIterationCounts; i++)
      {
        CircleRelaxation(pointList, iCollisionDistance);
      }
      A = GetCircles(pointList, circleList, iCollisionDistance);
    }
# ---------- circle_relaxation: C# additional code ----------
  // declare the persistent data
  List<Point3d> pointList;
  List<Circle> circleList;

  // function to detect collisions and move points apart
  public void CircleRelaxation(List<Point3d> pointList, double collisionDistance)
  {
    List<Vector3d> movingVectors = new List<Vector3d>();
    List<int> collisionCounts = new List<int>();

    for (int i = 0; i < pointList.Count; i++)
    {
      movingVectors.Add(new Vector3d(0, 0, 0));
      collisionCounts.Add(0);
    }

    for (int i = 0; i < pointList.Count; i++)
    {
      for (int j = i + 1; j < pointList.Count; j++)
      {
        Point3d ptA = pointList[i];
        Point3d ptB = pointList[j];
        Vector3d move = ptA - ptB; // from B to A
        double distance = move.Length;
        if (distance < collisionDistance)
        {
          move.Unitize();
          movingVectors[i] += 0.5 * (collisionDistance - distance) * move;
          movingVectors[j] -= 0.5 * (collisionDistance - distance) * move;
          collisionCounts[i] += 1;
          collisionCounts[j] += 1;
        }

      }

    }

    for (int i = 0; i < pointList.Count; i++)
      if (collisionCounts[i] > 0)
        pointList[i] += movingVectors[i] / collisionCounts[i];
  }

  public List<Circle> GetCircles(List<Point3d> pointList, List<Circle> circleList, double collisionDistance)
  {
    circleList = new List<Circle>();
    for (int i = 0; i < pointList.Count; i++)
    {
      double radius = collisionDistance / 2.0;
      Circle cirlce = new Circle(pointList[i], radius);
      circleList.Add(cirlce);
    }
    return circleList;
  }
# ---------- end circle_relaxation ----------
script_parasite = ScriptParasite(Enable=Toggle(True), Folder="/Users/siennasun/Downloads/CircleRelaxation")

division = Division(A=number_slider, B=2)
circle_2 = Circle(Plane=circle_relaxation.A, Radius=division)
