# Grasshopper definition Curve Subdivision.gh (Grasshopper 1.0.7)
# plug-ins: ScriptParasite

_2d_curve = Curve(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)
_3d_curve = Curve(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)
trigger = Trigger(Interval=20, TimerInterval=20, Target=curve_subdivision)  # disabled
imaxvertexcount = Slider(5000, range=0..5000)
ilengthconstraint = Slider(5, range=0..20)
icollisiondistance = Slider(6.4, range=0..20)
iiterationcount = Slider(3, range=0..10)
divide_curve = DivideCurve(Curve=_3d_curve, Count=10, Kinks=False)  # -> Points, Tangents, Parameters

curve_subdivision = CSharpScript(
    iReset=Toggle(True),
    iPoints=divide_curve.Points,
    iIterationCount=iiterationcount,
    iMaxVertexCount=imaxvertexcount,
    iCollisionDistance=icollisiondistance,
    iLengthConstraint=ilengthconstraint,
    Reference=["/Users/siennasun/Library/Application Support/McNeel/Rhinoceros/8.0/Plug-ins/Grasshopper (b45a29b1-4343-4035-989e-044e8580d9cf)/Libraries/plankton-69/Plankton.dll", "/Users/siennasun/Library/Application Support/McNeel/Rhinoceros/8.0/Plug-ins/Grasshopper (b45a29b1-4343-4035-989e-044e8580d9cf)/Libraries/plankton-69/PlanktonGh.dll"])  # -> out, oPoints, oCurve; inputs iReset: Boolean, iPoints: list of Point3d, iIterationCount: Int32, iMaxVertexCount: Int32, iCollisionDistance: Double, iLengthConstraint: Double
# ---------- curve_subdivision: C# ----------
    if (iReset)
    {
      pointList = new List<Point3d>(iPoints);
    }
    else
    {
      for (int i = 0;  i < iIterationCount; i++)
      {
        if (pointList.Count < iMaxVertexCount)
        {
          DivideCurve(pointList, iLengthConstraint);
        }
        ProcessCollision(pointList, iCollisionDistance);
      }
    }
    DrawCurves(pointList, ref oCurve);
    oPoints = pointList;
# ---------- curve_subdivision: C# additional code ----------
  

  // ------------------------------------------------------------
  // declare the persistent variables here
  List<Point3d> pointList;
  Random randomGenerator = new Random();
  

  // ------------------------------------------------------------
  // function to insert mid points if the segment is too long
  // pointList will be updated--more points to be added
  public void DivideCurve(List<Point3d> pointList, double iLengthConstraint)
  {
    // conditional for loop
    for (int i = 0; i < pointList.Count - 1;)
    {
      Point3d ptA = pointList[i];
      Point3d ptB = pointList[i + 1];
      double distance = ptA.DistanceTo(ptB);
      if (distance > iLengthConstraint)
      {
        // strategy 1: insert mid point
        Point3d midPt = new Point3d((ptA.X + ptB.X) / 2, (ptA.Y + ptB.Y) / 2, (ptA.Z + ptB.Z) / 2);

        // strategy 2: insert random point
        double t = randomGenerator.NextDouble(); // 0 to 1
        LineCurve line = new LineCurve(ptA, ptB);
        Point3d randomPt = line.PointAt(t);
        pointList.Insert(i + 1, randomPt);
      }
      else
      {
        i++;
      }
    }
  }

  // ------------------------------------------------------------
  // detect collision
  // pointList will be updated--points will be moved
  public void ProcessCollision(List<Point3d> pointList, double collisionDistance)
  {
    List<Vector3d> moveVectors = new List<Vector3d>(new Vector3d[pointList.Count]);
    List<int> collisionCounts = new List<int>(new int[pointList.Count]);

    for (int i = 0; i < pointList.Count; i++)
    {
      for (int j = i + 1; j < pointList.Count; j++)
      {
        Point3d ptA = pointList[i];
        Point3d ptB = pointList[j];
        double distance = ptA.DistanceTo(ptB);

        if (distance < collisionDistance)
        {
          // for debugging
          Print(i.ToString() + " " + j.ToString() + " " + "true");

          Vector3d move = ptA - ptB; // from B to A
          move.Unitize();
          moveVectors[i] += 0.5 * (collisionDistance - distance) * move;
          moveVectors[j] -= 0.5 * (collisionDistance - distance) * move;
          collisionCounts[i]++;
          collisionCounts[j]++;
        }

      }
    }

    for (int i = 0; i < pointList.Count; i++)
    {
      if (collisionCounts[i] > 0)
      {
        Vector3d averageMovingDirection = moveVectors[i] / collisionCounts[i];
        pointList[i] += averageMovingDirection;
      }
    }
  }

  // ------------------------------------------------------------
  // draw curves
  public void DrawCurves(List<Point3d> pointList, ref object curve)
  {
    Polyline polyline = new Polyline(pointList);
    curve = polyline;
  }
# ---------- end curve_subdivision ----------
script_parasite = ScriptParasite(Enable=Toggle(True), Folder="/Users/siennasun/Downloads/CurveSubdivision")

curve = Curve(curve_subdivision.oCurve)
panel = Panel(curve_subdivision.out)
list_length = ListLength(List=curve_subdivision.oPoints)
point = Point(curve_subdivision.oPoints)
panel_2 = Panel(list_length)
